% Simulink data dictionary CANLights.sldd

SteeringWheelPositionThresholdOff = Simulink.Parameter(15, DataType="int8", Unit="deg")

en_TurnSignal = enum(DefaultValue="SignalOff", StorageType="uint8")  % Enumeration of turn signal status
  SignalOff = 0  % Turn signal is off
  SignalLeft = 1  % Left turn signal is on
  SignalRight = 2  % Right turn signal is on

SteeringWheelAngle_LUT = Simulink.LookupTable(
  Table=Simulink.lookuptable.Table(
    Value=[-45 45],
    Dimensions=[1 2],
    DataType="int16",
    Unit="deg",
    FieldName="SteeringWheelAngleDeg"),
  BreakpointsSpecification="Explicit values",
  Breakpoints=Simulink.lookuptable.Breakpoint(
    Description="Counts for 10 bit analog in",
    Value=[0 1023],
    TunableSizeName="N1",
    Dimensions=[1 2],
    DataType="uint16",
    Min=0,
    Max=1023,
    FieldName="AnalogCounts"))

SteeringWheelPositionThresholdOn = Simulink.Parameter(35, DataType="int8", Unit="deg")

en_Mode = enum(DefaultValue="Off", StorageType="int8")
  Off = 0  % Lights off
  Auto = 1  % Lights respond to steering wheel input
  On = 2  % Lights always on

ConfigSet = Simulink.ConfigSet(StartTime="0", StopTime="inf", FixedStep=".01", Solver="FixedStepDiscrete", ProdHWDeviceType="Atmel->AVR", SystemTargetFile="ert.tlc", HardwareBoard="Arduino Mega 2560", TargetLang="C")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
NoOfModes = Simulink.Parameter(2, DataType="uint8")